# Grasshopper definition Primary Truss Generator.gh (Grasshopper 1.0.8)

# Primary Trusses
eml_primary_truss_output_lines = Curve()

# ---- group: Targeted Upper Element Length
primary_truss_targeted_upper_element_len = Slider(18.5, range=1..22)  # "primary_truss_targeted_upper_element_length"

# ---- group: Truss Depth
primary_truss_depth = Slider(30, range=10..45)

# ----
line = Line(simplify(graft(eml_primary_truss_output_lines)))
panel = Panel("""0
-1""")
panel_2 = Panel("""0
-1""")
len = Length(Curve=line)
Z = UnitZ(Factor=expr("-x", primary_truss_depth))
panel_3 = Panel(len)
division = Division(A=len, B=primary_truss_targeted_upper_element_len)
panel_4 = Panel("""0
1
-1
-2""")
int = Integer(division)
eval = Evaluate(E="Round(x/4)*4", x=int)

# ---- group: number of panels
int_2 = Integer(eval)

# ----
divide = DivideCurve(Curve=line, Count=eval, Kinks=False)  # -> simplify(Points), Tangents, Parameters
dispatch = Dispatch(List=divide.Points, DispatchPattern=[True, False])  # -> ListA, ListB
pt = Point(dispatch.ListB)
cull_i = CullIndex(List=dispatch.ListA, Indices=panel, Wrap=True)
cull_i_2 = CullIndex(List=cull_i, Indices=panel_2, Wrap=True)
move = Move(Geometry=divide.Points, Motion=Z)  # -> Geometry, Transform
dispatch_2 = Dispatch(List=cull_i_2, DispatchPattern=[True, False])  # -> ListA, ListB
dispatch_3 = Dispatch(List=cull_i, DispatchPattern=[True, False])  # -> ListA, ListB
item = ListItem(List=divide.Points, Index=0, Wrap=True)  # -> Item2, Item1, Item, Item1_2
cull_i_3 = CullIndex(List=move.Geometry, Indices=panel_4, Wrap=True)  # -> simplify(List)
dispatch_4 = Dispatch(List=cull_i_3, DispatchPattern=[True, False])  # -> ListA, ListB
pt_2 = Point(dispatch_4.ListB)
pt_3 = Point(dispatch_4.ListA)
ln = Line(StartPoint=cull_i, EndPoint=pt_3)
dispatch_5 = Dispatch(List=pt_3, DispatchPattern=[True, False])  # -> ListA, ListB
pt_4 = Point(dispatch_5.ListA)
item_2 = ListItem(List=cull_i_3, Index=0, Wrap=True)  # -> Item1, Item
pt_5 = Point(dispatch_3.ListA)
ln_2 = Line(StartPoint=item.Item1, EndPoint=item_2.Item1)
ln_3 = Line(StartPoint=item.Item, EndPoint=item_2.Item)
project = ProjectPoint(Point=item.Item2, Direction=Vector(0, 0, -1), Geometry=ln_2)  # -> Point, Index
project_2 = ProjectPoint(Point=item.Item1_2, Direction=Vector(0, 0, -1), Geometry=ln_3)  # -> Point, Index
relitem = RelativeItem(Tree=divide.Points, Offset="{0}[+1]", WrapPaths=False, WrapItems=False)  # -> ItemA, ItemB
relitem_2 = RelativeItem(Tree=cull_i_3, Offset="{0}[+1]", WrapPaths=False, WrapItems=False)  # -> ItemA, ItemB
crv_cp = CurveClosestPoint(Point=project.Point, Curve=ln_2)  # -> Point, Parameter, Distance
crv_cp_2 = CurveClosestPoint(Point=project_2.Point, Curve=ln_3)  # -> Point, Parameter, Distance
merge = Merge(Data1=crv_cp_2.Point, Data2=pt_2, Data3=crv_cp.Point)
ln_4 = Line(StartPoint=pt, EndPoint=merge)
cull_i_4 = CullIndex(List=ln_4, Indices=panel_2, Wrap=True)
midpt = CurveMiddle(Curve=cull_i_4)  # -> simplify(Midpoint)
crv_cp_3 = CurveClosestPoint(Point=midpt, Curve=cull_i_4)  # -> Point, Parameter, Distance
merge_2 = Merge(Data1=crv_cp_2.Point, Data2=midpt, Data3=crv_cp.Point)
shatter = Shatter(Curve=cull_i_4, Parameters=crv_cp_3.Parameter)
dispatch_6 = Dispatch(List=midpt, DispatchPattern=[True, False])  # -> ListA, ListB
item_3 = ListItem(List=ln_4, Index=0, Wrap=True)  # -> Item1, Item
weave = Weave(
    Pattern=[0, 1, 2, 3],
    Stream0=pt_4,
    Stream1=dispatch_6.ListA,
    Stream2=dispatch_2.ListA,
    Stream3=dispatch_6.ListB,
    NullGaps=False)  # -> simplify(Weave)
dispatch_7 = Dispatch(List=merge_2, DispatchPattern=[True, False])  # -> ListA, ListB
relitem_3 = RelativeItem(Tree=weave, Offset="{0}[+1]", WrapPaths=False, WrapItems=False)  # -> ItemA, ItemB
merge_3 = Merge(Data1=item_3.Item, Data2=shatter, Data3=item_3.Item1)
ln_5 = Line(StartPoint=relitem.ItemA, EndPoint=relitem.ItemB)
ln_6 = Line(StartPoint=relitem_2.ItemA, EndPoint=relitem_2.ItemB)  # -> flatten(Line)
ln_7 = Line(StartPoint=dispatch_7.ListB, EndPoint=pt_5)
ln_8 = Line(StartPoint=dispatch_7.ListA, EndPoint=pt_5)
ln_9 = Line(StartPoint=relitem_3.ItemA, EndPoint=relitem_3.ItemB)
shatter_2 = Shatter(Curve=ln_2, Parameters=crv_cp.Parameter)  # -> reverse(flatten(Segments))
shatter_3 = Shatter(Curve=ln_3, Parameters=crv_cp_2.Parameter)  # -> flatten(Segments)
merge_4 = Merge(Data1=shatter_3, Data2=ln_6, Data3=shatter_2)
eml_primary_truss_upper_cord_lines = Line(flatten(ln_5))
eml_primary_truss_bottom_cord_lines = Line(flatten(merge_4))
eml_primary_truss_primary_vertical_lines = Line(flatten(ln))
eml_primary_truss_primary_diagonal_lines = Line(flatten(ln_9))
eml_primary_truss_secondary_diagonal_lin = Line(flatten([ln_8, ln_7]))  # "eml_primary_truss_secondary_diagonal_lines"
eml_primary_truss_secondary_vertical_lin = Line(flatten(merge_3))  # "eml_primary_truss_secondary_vertical_lines"
